# Dynamo graph PrintedGeometryPy.dyn (Dynamo 2.13.1.3887)

# group: unsymmetric test
division_position = DoubleSlider(0.02, range=-0.15..0.15 step 0.001)
splitInnerSurface = Custom[SplitInnerSurface](division=division_position)  # unwired: dict, centerSurface

# group: adhoc export
string = StringInput("SimpleWall")
directory_path = Directory("C:\Users\ne63bic\SharedFiles\CAD\Revit\Dynamo\PathExport")
code_block = CodeBlock(name=string, ordner=directory_path)  # unwired: data, geo
# ---------- code_block.designscript (15 lines) ----------
data;

NoP = data["NoP"];
//path = data["Path"];
path = geo.Explode();
pattern = data["Pattern"];
nozzleD:int = data["NozzleD"]*1000;
layerH:int = data["LayerH"]*1000;
layers = List.Count(data["Planes"]);
NoZ = data["NoZ"];

name;
ordner;

file = ordner + "\\" + name + "_" + pattern + "_" + layers + "L" + nozzleD + "N" + layerH + "H" + NoP + "P" + NoZ + "Z" + ".pp";
# ----------------------------------------
execute = BoolSelector(false)
export_pp = Python(IN[0]=code_block.path, IN[1]=code_block.file, IN[2]=execute)  # CPython3
# ---------- export_pp.python (65 lines) ----------
# Phython-Standard- und DesignScript-Bibliotheken laden
import sys
import os
import clr
clr.AddReference('ProtoGeometry')
from Autodesk.DesignScript.Geometry import *
#clr.AddReference("C:\\Users\\ne63bic\\SharedFiles\\CAD\\Revit\\Dynamo\\IFC\\IFCexporter.dll")
#from IFCexporter import *

# Die Eingaben für diesen Block werden in Form einer Liste in den IN-Variablen gespeichert.
curves = IN[0]
filename = IN[1]
success = False

if IN[2]:
    f = open(r"{}".format(filename), "w")
    try:
    	for count, c in enumerate(curves):
    		if isinstance(c,Line):
    			t  = "Line"
    			sP = c.StartPoint
    			eP = c.EndPoint
    			
    			l  = "{}; {}; [{} {} {}]; [{} {} {}]\n".format(count, 
    			                                               t, 
    			                                               round(sP.X,4), 
    			                                               round(sP.Y,4), 
    			                                               round(sP.Z,4), 
    			                                               round(eP.X,4), 
    			                                               round(eP.Y,4), 
    			                                               round(eP.Z,4)) 
    			
    		elif isinstance(c,Arc):
    			t = "Arc"
    			cP = c.CenterPoint
    			r  = c.Radius
    			n  = c.Normal
    			a1 = c.StartAngle
    			a2 = c.StartAngle + c.SweepAngle
    			
    			l  = "{}; {}; [{} {} {}]; [{} {} {}]; {}; {}; {}\n".format(count, t, round(cP.X,4), round(cP.Y,4), round(cP.Z,4), round(n.X,4), round(n.Y,4), round(n.Z,4), round(r,4), round(a1,4), round(a2,4))
    			
    		elif isinstance(c,NurbsCurve):
    		    t = "Spline"
    		    cP = c.ControlPoints()
    		    deg = c.Degree()
    		    
    		    l = "{}; {}; {}".format(count, t, deg)
    		    
    		    for p in cP:
    		        l = "{}; [{} {} {}]".format(l, round(p.X,4), round(p.Y,4), round(p.Z,4))
    		    
    		    l = "{}\n".format(l)
    			
    		else:
    			l  = "{}; not detected\n".format(count)
    			
    		f.write(l)
    
    except:
    	success = False
    finally:
    	f.close()

OUT = [success, filename]
# ----------------------------------------

# group: Surface visualization
code_block_2 = CodeBlock()  # frozen; unwired: Out
# ---------- code_block_2.designscript (7 lines) ----------
heigth = Out["Height"];
width = Out["Width"];
solid = Out["Solid"];
bbox = Out["BB"];
nos = Out["NoS"];
center = Out["CenterS"];
cf = Out["PerimeterS"];
# ----------------------------------------
code_block_3 = CodeBlock { 0; 1; }
byCoordinates = UV.ByCoordinates(u=code_block_3.out0, v=code_block_3.out0)
byCoordinates_2 = UV.ByCoordinates(u=code_block_3.out1, v=code_block_3.out1)
byParameterLineOnSurface = Curve.ByParameterLineOnSurface(baseSurface=code_block_2.center, startParams=byCoordinates, endParams=byCoordinates_2)  # frozen
bySolid = PolySurface.BySolid(solid=code_block_2.solid)
surfaces = PolySurface.Surfaces(polySurface=bySolid)
code_block_4 = CodeBlock { 1; }
getItemAtIndex = List.GetItemAtIndex(list=surfaces, index=code_block_4)
code_block_5 = CodeBlock { 100; 0; 250; }
byARGB = Color.ByARGB(alpha=code_block_5.out0, red=code_block_5.out1, blue=code_block_5.out2)
byGeometryColor = Modifiers.GeometryColor.ByGeometryColor(geometry=getItemAtIndex, color=byARGB)

# group: extract printing path points for robot control
string_2 = StringInput("SimpleWall")
directory_path_2 = Directory("C:\Users\ne63bic\SharedFiles\CAD\Revit\Dynamo\Export")
code_block_6 = CodeBlock(name=string_2, ordner=directory_path_2)  # frozen; unwired: data, geo
# ---------- code_block_6.designscript (15 lines) ----------
data;

NoP = data["NoP"];
//path = data["Path"];
path = geo.Explode();
pattern = data["Pattern"];
nozzleD:int = data["NozzleD"]*1000;
layerH:int = data["LayerH"]*1000;
layers = List.Count(data["Planes"]);
NoZ = data["NoZ"];

name;
ordner;

file = ordner + "\\" + name + "_" + pattern + "_" + layers + "L" + nozzleD + "N" + layerH + "H" + NoP + "P" + NoZ + "Z" + ".script";
# ----------------------------------------
divisions = IntegerSlider(6, range=0..20 step 1)
split_into_waypoints = Python(IN[0]=code_block_6.path, IN[1]=divisions)  # CPython3
# ---------- split_into_waypoints.python (29 lines) ----------
# Phython-Standard- und DesignScript-Bibliotheken laden
import sys
import clr
clr.AddReference('ProtoGeometry')
from Autodesk.DesignScript.Geometry import *
clr.AddReference('DSCoreNodes')
import DSCore
from DSCore import List
import math

# Die Eingaben für diesen Block werden in Form einer Liste in den IN-Variablen gespeichert.
curves = IN[0]
noop = IN[1]

# Code unterhalb dieser Linie platzieren
pList = []

for c in curves:
    P1 = c.StartPoint
    pList.append(P1)
    if noop > 0 and not isinstance(c,Line):
        P2 = c.PointsAtEqualChordLength(noop)
        pList.extend(P2)
        
P3 = c.EndPoint
pList.append(P3)

# Weisen Sie Ihre Ausgabe der OUT-Variablen zu.
OUT = pList
# ----------------------------------------
X = Point.X(point=split_into_waypoints)
Y = Point.Y(point=split_into_waypoints)
Z = Point.Z(point=split_into_waypoints)
execute_2 = BoolSelector(false)
export_wps_to_urscript = Python(IN[0]=X, IN[1]=Y, IN[2]=Z, IN[3]=code_block_6.file, IN[4]=execute_2)  # CPython3
# ---------- export_wps_to_urscript.python (26 lines) ----------
# Phython-Standard- und DesignScript-Bibliotheken laden
import sys
import clr
clr.AddReference('ProtoGeometry')
from Autodesk.DesignScript.Geometry import *

# Die Eingaben für diesen Block werden in Form einer Liste in den IN-Variablen gespeichert.

if IN[4]:
    filename = IN[3]
    f = open(filename,"wt")
    
    try:
        X = [round(x,4) for x in IN[0]]
        Y = [round(y,4) for y in IN[1]]
        Z = [round(z,4) for z in IN[2]]
        f.write("global X = {}\n".format(X))
        f.write("global Y = {}\n".format(Y))
        f.write("global Z = {}\n".format(Z))
        f.write("global NrPoints = {}\n".format(len(IN[1])))
        f.write("global a = 1.2\nglobal v = 0.015\nglobal r = 0.001\nglobal StartPunkt = LCS_Zero")
        OUT = 1
    except:
        OUT = 0
    finally:
        f.close()
# ----------------------------------------

# group: inner Lamella
code_block_7 = CodeBlock { null; 0; }
code_block_8 = CodeBlock { dict: var[]..[]; }  # unwired: dict
dictToVar = Custom[DictToVar](dict=code_block_8)  # frozen; Extracts dictionary content
createAccess = Custom[CreateAccess](nozzleD=dictToVar.nozzleD, outerPrintingPath=dictToVar.path, accessIdx=dictToVar.accIdx)  # Cuts surrounding printing path at access point and returns access geometry
create_perimeter_offset_and = CodeBlock(perimeter=dictToVar.perimeter, nozzleD=dictToVar.nozzleD, reversed=dictToVar.reversed, nos=dictToVar.numberOfSolids)  # "Create perimeter offset and reverse it if necessary"
# ---------- create_perimeter_offset_and.designscript (34 lines) ----------
offPer = Autodesk.DesignScript.Geometry.Curve.Offset(perimeter,-nozzleD);
exPer = Geometry.Explode(offPer);
!reversed;
nos;
outerPer = [Imperative]{
if (!reversed)
{
reverted=[];
for (i in 0..List.Count(exPer)-1)
{
reverted[i]=List.Reverse(exPer[i]);
}
return PolyCurve.Reverse(reverted);
}
else
{
return exPer;
}
};
shiftIdx = [Imperative]{
if (!reversed)
{
return 1;
}
else
{
return nos-1;
}
};
outer = List.ShiftIndices(outerPer@L2<1>,shiftIdx);
outerPoly = PolyCurve.ByJoinedCurves(outer,0.0001);
offOuter = Autodesk.DesignScript.Geometry.Curve.Offset(outerPoly,-nozzleD);
inner = Geometry.Explode(offOuter);
middleCurve = List.GetItemAtIndex(outer@L2<1>,nos);
# ----------------------------------------
removeSides = Custom[RemoveSides](geometry=create_perimeter_offset_and.out6, numberOfSolids=dictToVar.numberOfSolids)  # Removes the sides of a perimeter curve by bool mask.
code_block_9 = CodeBlock(c=removeSides.outerBorder, nozzleD=dictToVar.nozzleD)
# ---------- code_block_9.designscript (4 lines) ----------
curves = PolyCurve.Curves(c);
len = Autodesk.DesignScript.Geometry.Curve.Length(curves);
off1 = nozzleD/len;
off2 = 1-off1;
# ----------------------------------------
trimByParameter = Curve.TrimByParameter(curve=code_block_9.curves@L2, startParameter=code_block_9.off1@L2, endParameter=code_block_9.off2@L2)
transpose = List.Transpose(lists=trimByParameter)
code_block_10 = CodeBlock { divisions: var[]..[]; }  # unwired: divisions
pointsAtEqualSegmentLength = Curve.PointsAtEqualSegmentLength(curve=transpose, divisions=code_block_10)
removeSides_2 = Custom[RemoveSides](geometry=create_perimeter_offset_and.out9, numberOfSolids=dictToVar.numberOfSolids)
code_block_11 = CodeBlock(c=removeSides_2.innerBorder, nozzleD=dictToVar.nozzleD)  # same code as code_block_9
trimByParameter_2 = Curve.TrimByParameter(curve=code_block_11.curves@L2, startParameter=code_block_11.off1@L2, endParameter=code_block_11.off2@L2)
transpose_2 = List.Transpose(lists=trimByParameter_2)
closestPointTo = Geometry.ClosestPointTo(geometry=transpose_2, other=pointsAtEqualSegmentLength)
byStartPointEndPoint = Line.ByStartPointEndPoint(startPoint=pointsAtEqualSegmentLength, endPoint=closestPointTo)
code_block_12 = CodeBlock { 2; 1; }
takeEveryNthItem = List.TakeEveryNthItem(list=byStartPointEndPoint@L2, n=code_block_12.out0, offset=code_block_12.out1)
count = List.Count(list=closestPointTo@L2)
code_block_13 = CodeBlock(x=count) { x-1; }
takeItems = List.TakeItems(list=closestPointTo@L2, amount=code_block_13@L1)
restOfItems = List.RestOfItems(list=closestPointTo@L2)
distanceTo = Geometry.DistanceTo(geometry=takeItems@L2, other=restOfItems@L2)
code_block_14 = CodeBlock(dist=distanceTo, nozzleD=dictToVar.nozzleD, c=takeEveryNthItem)
# ---------- code_block_14.designscript (8 lines) ----------
fdist = List.Flatten(dist);
r = Math.Round(List.FirstItem(fdist),4) - nozzleD/2;
l = Curve.Length(c);
par = (l-r)/l;
vec1 = Line.Direction(c);
vec2 = Vector.YAxis();
angle1 = Vector.AngleWithVector(vec1,vec2) - 180;
angle2 = angle1 + 180;
# ----------------------------------------
trimByEndParameter = Curve.TrimByEndParameter(curve=takeEveryNthItem, endParameter=code_block_14.par)
endPoint = Curve.EndPoint(curve=trimByEndParameter)
byCenterPointRadiusAngle = Arc.ByCenterPointRadiusAngle(center=endPoint, radius=code_block_14.r, startAngle=code_block_14.angle2, endAngle=code_block_14.angle1)
firstItem = List.FirstItem(list=byCenterPointRadiusAngle@L2)
restOfItems_2 = List.RestOfItems(list=byCenterPointRadiusAngle@L2)
takeEveryNthItem_2 = List.TakeEveryNthItem(list=byStartPointEndPoint@L2, n=code_block_12.out0)
count_2 = List.Count(list=pointsAtEqualSegmentLength@L2)
code_block_15 = CodeBlock(x=count_2) { x-1; }
takeItems_2 = List.TakeItems(list=pointsAtEqualSegmentLength@L2, amount=code_block_15@L1)
restOfItems_3 = List.RestOfItems(list=pointsAtEqualSegmentLength@L2)
distanceTo_2 = Geometry.DistanceTo(geometry=takeItems_2@L2, other=restOfItems_3@L2)
code_block_16 = CodeBlock(dist=distanceTo_2, nozzleD=dictToVar.nozzleD, c=takeEveryNthItem_2)
# ---------- code_block_16.designscript (8 lines) ----------
fdist = List.Flatten(dist);
r = Math.Round(List.FirstItem(fdist),4) - nozzleD/2;
l = Curve.Length(c);
par = r/l;
vec1 = Line.Direction(c);
vec2 = Vector.YAxis();
angle1 = Vector.AngleWithVector(vec1,vec2) - 180;
angle2 = angle1 + 180;
# ----------------------------------------
trimByStartParameter = Curve.TrimByStartParameter(curve=takeEveryNthItem_2, startParameter=code_block_16.par)
startPoint = Curve.StartPoint(curve=trimByStartParameter)
byCenterPointRadiusAngle_2 = Arc.ByCenterPointRadiusAngle(center=startPoint, radius=code_block_16.r, startAngle=code_block_16.angle1, endAngle=code_block_16.angle2)
code_block_17 = CodeBlock { true; false; }
byBlendBetweenCurves = Curve.ByBlendBetweenCurves(curve1=byCenterPointRadiusAngle_2, curve2=restOfItems_2, endOrStart1=code_block_17.out1)
byBlendBetweenCurves_2 = Curve.ByBlendBetweenCurves(curve1=byCenterPointRadiusAngle, curve2=byCenterPointRadiusAngle_2, endOrStart2=code_block_17.out0)
join = Curve.Join(curve=byBlendBetweenCurves_2@@L1, curves=byCenterPointRadiusAngle_2@L1)
join_2 = Curve.Join(curve=byBlendBetweenCurves@@L1, curves=join@L1)
join_3 = Curve.Join(curve=restOfItems_2@@L1, curves=join_2@L1)
join_4 = Curve.Join(curve=firstItem@L1, curves=join_3@L2)
startCurve = Custom[StartCurve](perimeter=dictToVar.perimeter, reverse=dictToVar.reversed, numberOfSolids=dictToVar.numberOfSolids, nozzleD=dictToVar.nozzleD)  # Creates a offset curve that connects to the outer perimeter
startPoint_2 = Curve.StartPoint(curve=trimByParameter@L1)
parameterAtPoint = Curve.ParameterAtPoint(curve=startCurve, point=startPoint_2)
trimByEndParameter_2 = Curve.TrimByEndParameter(curve=startCurve, endParameter=parameterAtPoint)
byBlendBetweenCurves_3 = Curve.ByBlendBetweenCurves(curve1=firstItem, curve2=trimByEndParameter_2, endOrStart1=code_block_17.out1, endOrStart2=code_block_17.out0)
join_5 = Curve.Join(curve=join_4@L1, curves=byBlendBetweenCurves_3@L1)
lastItem = List.LastItem(list=byCenterPointRadiusAngle@L2)
endPoint_2 = Curve.EndPoint(curve=transpose@L2)
startPoint_3 = Curve.StartPoint(curve=create_perimeter_offset_and.out10@L2)
byStartPointEndPoint_2 = Line.ByStartPointEndPoint(startPoint=endPoint_2@L1, endPoint=startPoint_3@L1)
byBlendBetweenCurves_4 = Curve.ByBlendBetweenCurves(curve1=lastItem@L1, curve2=byStartPointEndPoint_2@L1)
join_6 = Curve.Join(curve=join_5@L1, curves=byBlendBetweenCurves_4@L1)
code_block_18 = CodeBlock(geo=create_perimeter_offset_and.out6, nozzleD=dictToVar.nozzleD)
# ---------- code_block_18.designscript (3 lines) ----------
c=List.LastItem(geo@L2<1>);
startPar=1-nozzleD/Autodesk.DesignScript.Geometry.Curve.Length(c);
Autodesk.DesignScript.Geometry.Curve.TrimByEndParameter(c,startPar);
# ----------------------------------------
endPoint_3 = Curve.EndPoint(curve=code_block_18.out2)
byStartPointEndPoint_3 = Line.ByStartPointEndPoint(startPoint=endPoint_3, endPoint=createAccess.accessPoint)
code_block_19 = CodeBlock(zickZack=join_6, middleCurve=create_perimeter_offset_and.out10, zToMid=byStartPointEndPoint_2, firstPart=trimByEndParameter_2, sideBack=removeSides.innerBorder, last=code_block_18.out2, connect=byStartPointEndPoint_3)
# ---------- code_block_19.designscript (5 lines) ----------
p1 = Autodesk.DesignScript.Geometry.Curve.EndPoint(zickZack);
p2 = Autodesk.DesignScript.Geometry.Curve.StartPoint(middleCurve);
zToMid;
l = [firstPart,zickZack,zToMid,middleCurve,sideBack,last,connect];
PolyCurve.ByJoinedCurves(List.Transpose(l),0.01);
# ----------------------------------------
connect_inner_to_outer_path = CodeBlock(accCurve=createAccess.accessCurve, innerPer=code_block_19.out4, outerPath=dictToVar.path, accIdx=dictToVar.accIdx)
# ---------- connect_inner_to_outer_path.designscript (5 lines) ----------
innerPerAcc = List.ReplaceItemAtIndex(accCurve@L2<1>,1,innerPer@L1<1>);
innerPoly = PolyCurve.ByJoinedCurves(innerPerAcc@L2<1>,0.01);
outerPathEx = Geometry.Explode(outerPath);
totalPath = List.ReplaceItemAtIndex(outerPathEx@L2<1>,accIdx,innerPoly@L1<1>);
Autodesk.DesignScript.Geometry.Curve.Join(List.FirstItem(totalPath@L2<1>),List.RestOfItems(totalPath@L2<1>));
# ----------------------------------------
varToDict = Custom[VarToDict](perimeter=code_block_7.out0, path=connect_inner_to_outer_path.out4, accIdx=code_block_7.out1, reversed=create_perimeter_offset_and.out2, numberOfSolids=dictToVar.numberOfSolids, counter=code_block_7.out1, nozzleD=dictToVar.nozzleD)  # Creates dictionary from Variables
code_block_20 = CodeBlock(dict=varToDict) { dict; }

# group: path finish and solid sweep, does not always work and takes some time to execute
code_block_21 = CodeBlock { 0; 1; 2; 2.5; 5; }  # frozen
byCoordinates_3 = Point.ByCoordinates(x=code_block_21.out2, y=code_block_21.out0, z=code_block_21.out0)
byCoordinates_4 = Point.ByCoordinates(x=code_block_21.out4, y=code_block_21.out3, z=code_block_21.out1)
byCorners = Cuboid.ByCorners(lowPoint=byCoordinates_3, highPoint=byCoordinates_4)
get_printer_parameters = CodeBlock()
# ---------- get_printer_parameters.designscript (4 lines) ----------
lH = GlobalParameter.FindByName("layerH");
GlobalParameter.Value(lH);
nD = GlobalParameter.FindByName("nozzleD");
GlobalParameter.Value(nD);
# ----------------------------------------
input_and_inter_layer_curves = CodeBlock()  # frozen; unwired: curve
# ---------- input_and_inter_layer_curves.designscript (6 lines) ----------
curve;
List.FirstItem(PolyCurve.NumberOfCurves(curve));
nol = List.Count(curve)-1;
p1 = List.TakeItems(Curve.EndPoint(curve),nol);
p2 = List.RestOfItems(Curve.StartPoint(curve));
Line.ByStartPointEndPoint(p1,p2);
# ----------------------------------------
explode = Geometry.Explode(geometry=input_and_inter_layer_curves.curve)
regularCrossSection = Custom[RegularCrossSection](nozzleSize=get_printer_parameters.out3, layerThickness=get_printer_parameters.out1, geometry=explode, numberOfCurves=input_and_inter_layer_curves.out1)  # Creates a cross section of a 3D printing layer
bySweep = Solid.BySweep(profile=regularCrossSection.crossSection, path=explode)
byUnion = Solid.ByUnion(solids=bySweep)  # frozen
byUnion_2 = Solid.ByUnion(solids=byUnion)
differenceAll = Solid.DifferenceAll(solid=byCorners, others=byUnion_2)
join_7 = List.Join()  # unwired: list0, list1
code_block_22 = CodeBlock(endCS=regularCrossSection.crossSection, nol=input_and_inter_layer_curves.nol) { List.RestOfItems(List.FirstItem(endCS@L2<1>)); List.TakeItems(List.Flatten(ilCS,-1),nol); }  # frozen; unwired: ilCS
combine = List.Combine(combineFunction=join_7, list0=code_block_22.out1, list1=code_block_22.out0)
byLoft = Solid.ByLoft(crossSections=combine)
byUnion_3 = Solid.ByUnion(solids=byLoft)
differenceAll_2 = Solid.DifferenceAll(solid=differenceAll, others=byUnion_3)
differenceAll_3 = Solid.DifferenceAll(solid=byCorners, others=differenceAll_2)
startPoint_4 = Curve.StartPoint(curve=regularCrossSection.revolveCrossSection)
code_block_23 = CodeBlock { 360; }
byRevolve = Solid.ByRevolve(profile=regularCrossSection.revolveCrossSection@L2, axisOrigin=startPoint_4@L2, sweepAngle=code_block_23)
byUnion_4 = Solid.ByUnion(solids=byRevolve@L2)  # frozen
byUnion_5 = Solid.ByUnion(solids=byUnion_4)
union = Solid.Union(solid=byUnion_5, solid_2=byUnion_2)  # frozen
union_2 = Solid.Union(solid=union, solid_2=byUnion_3)
volume = Solid.Volume(solid=union_2)
drawPrintedGeometry = Custom[DrawPrintedGeometry]()  # frozen; Creates a solid from a printing path by swiping a cross section along the path.; unwired: printingPath, nozzleD, layerH

# group: Select elements and features
select_wall = DSModelElementsByCategorySelection("OST_Walls")  # 1 picked in the model
select_robot = DSModelElementsByCategorySelection("OST_SpecialityEquipment")  # 1 picked in the model
select_inside = SelectFaces()  # 1 picked in the model
flatten = List.Flatten(list=select_inside)
select_sides_optional = SelectFaces()  # 2 picked in the model
flatten_2 = List.Flatten(list=select_sides_optional)
overwrite = BoolSelector(false)
code_block_24 = CodeBlock(wall=select_wall, robot=select_robot, inside=flatten, sides=flatten_2, owSides=overwrite)
# ---------- code_block_24.designscript (7 lines) ----------
{
"wall":wall,
"robot":robot,
"inside":inside,
"sides":sides,
"owSides":owSides
};
# ----------------------------------------

# group: Debug settings
reduce = BoolSelector(true)
number_of_layers = IntegerSlider(5, range=1..11 step 1)
code_block_25 = CodeBlock(reduce=reduce, nol=number_of_layers)
# ---------- code_block_25.designscript (4 lines) ----------
{
"reduce":reduce,
"NoL":nol
};
# ----------------------------------------

# group: Set parameters / Define pattern
layer_thickness_m = DoubleSlider(0.01, range=0.01..12 step 0.005)
nozzle_size_m = DoubleSlider(0.015, range=0.01..0.4 step 0.005)
rounding_radius = DoubleSlider(0.005, range=0..0.1 step 0.001)
number_of_extra_perimeters = IntegerSlider(0, range=0..3 step 1)
pattern_number = IntegerSlider(0, range=0..3 step 1)
pattern_choice = CodeBlock(idx=pattern_number)
# ---------- pattern_choice.designscript (6 lines) ----------
List.GetItemAtIndex([
"ZickZack", // #0
"Lamella", // #1
"Honeycomb", // #2
"None" // #3
],idx);
# ----------------------------------------
segment_length_preset = DoubleSlider(0.48, range=0..1 step 0.01)
define_pattern = Python(IN[0]=layer_thickness_m, IN[1]=nozzle_size_m, IN[2]=rounding_radius, IN[3]=number_of_extra_perimeters, IN[4]=pattern_choice, IN[5]=segment_length_preset)  # CPython3
# ---------- define_pattern.python (17 lines) ----------
import sys
import importlib
sys.path.append(r'C:\Users\ne63bic\SharedFiles\CAD\Revit\Dynamo\Scripts')
import FIMpattern
fp = importlib.reload(FIMpattern)

userData = IN
patternclass = IN[4]

if patternclass:
    p = getattr(fp, patternclass)
    pattern = p()
    pattern.setParameters(IN[0], IN[1], IN[2], IN[3], IN[5])
    
    OUT = pattern
else:
    OUT = None
# ----------------------------------------

# group: Initialize project
execute_3 = BoolSelector(true)
initialize_component = Python(IN[0]=code_block_24, IN[1]=code_block_25, IN[2]=define_pattern, IN[3]=execute_3)  # CPython3
# ---------- initialize_component.python (29 lines) ----------
import sys
import importlib
sys.path.append(r'C:\Users\ne63bic\SharedFiles\CAD\Revit\Dynamo\Scripts')
import FIMproject
importlib.reload(FIMproject)
from FIMproject import Project
from FIMlayer import Layer

p = Project(UnwrapElement)
wall = IN[0]["wall"]
robot = IN[0]["robot"]
inside = IN[0]["inside"]
sides = IN[0]["sides"]
ow = IN[0]["owSides"]
reduce = IN[1]["reduce"]
nol = IN[1]["NoL"]
pattern = IN[2]
exe = IN[3]

if exe:
    p.activate()
    p.prepareGeometry(wall, sides, ow, inside)
    p.addRobot(robot)
    p.addPattern(pattern)
    p.addLayers(reduce, nol)
    p.initLayers()


OUT = p
# ----------------------------------------

# group: Pathplanning
execute_4 = BoolSelector(true)
path_planning = Python(IN[0]=initialize_component, IN[1]=execute_4)  # CPython3
# ---------- path_planning.python (16 lines) ----------
import sys
import importlib
sys.path.append(r'C:\Users\ne63bic\SharedFiles\CAD\Revit\Dynamo\Scripts')
#import FIMproject
#importlib.reload(FIMproject)
#from FIMproject import Project
#from FIMlayer import Layer

p = IN[0]

if IN[1] and p.active:
    p.planPath()
else:
    p.deactivate()

OUT = p
# ----------------------------------------

# group: IFC export
directory_path_3 = Directory("C:\Users\ne63bic\SharedFiles\CAD\Revit\Dynamo\IFC")
ifc_tests = Python(IN[0]=path_planning, IN[1]=directory_path_3)  # CPython3; frozen
# ---------- ifc_tests.python (8 lines) ----------
import sys
import importlib
sys.path.append(r'C:\Users\ne63bic\SharedFiles\CAD\Revit\Dynamo\Scripts')
from FIMproject import Project

#if IN[2]:
#d = IN[0].__dict__
OUT = IN[0].export2IFC(IN[1])
# ----------------------------------------

# group: Testing
out_dictionary = Python(IN[0]=path_planning)  # CPython3
# ---------- out_dictionary.python (8 lines) ----------
import sys
import importlib
sys.path.append(r'C:\Users\ne63bic\SharedFiles\CAD\Revit\Dynamo\Scripts')
from FIMproject import Project

#if IN[2]:
d = IN[0].__dict__
OUT = d, d["bimdata"].__dict__, [l.__dict__ for l in d["layers"]]
# ----------------------------------------

code_block_26 = CodeBlock(x=out_dictionary) { x[2]["surface"]; }
code_block_27 = CodeBlock(x=code_block_26) { x[0]; }
geometry = Element.Geometry(element=select_wall)
flatten_3 = List.Flatten(list=geometry)
byUnion_6 = Solid.ByUnion(solids=flatten_3)
intersect = Geometry.Intersect(geometry=byUnion_6, other=code_block_26)
flatten_4 = List.Flatten(list=intersect)
firstItem_2 = List.FirstItem(list=flatten_4)
number_slider = DoubleSlider(1.14, range=0..2 step 0.01)
number_slider_2 = DoubleSlider(0.11, range=0..2 step 0.01)
pointAtParameter = Surface.PointAtParameter(surface=firstItem_2, u=number_slider, v=number_slider_2)

# group: Visualisierung
geometry_2 = Element.Geometry(element=select_wall)
python_script = Python(IN[0]=path_planning)  # CPython3
# ---------- python_script.python (6 lines) ----------
pr = IN[0]
rLCS = pr.showRobot()
path = [l.polyPath for l in pr.layers]


OUT = rLCS, path
# ----------------------------------------
